# Grasshopper definition Danai Sougkara - Assignment 2 - Buildings.gh (Grasshopper 1.0.7)

# ---- group: Remap_Example
construct_domain = ConstructDomain(DomainStart="-20", DomainEnd="20")
construct_domain_2 = ConstructDomain(DomainStart="0", DomainEnd="1")
remap_numbers = RemapNumbers(Value=Slider(0.75, range=0..1), Source=construct_domain_2, Target=construct_domain)  # -> Mapped, Clipped
panel = Panel(remap_numbers.Mapped)

# ---- group: DOWNTOWN ATTRACTOR
curve_blocks = Curve([<curve referenced from the Rhino model> x61])
flatten_tree = FlattenTree(Tree=curve_blocks, Path="{0}")
point = Point(<point referenced from the Rhino model>)
curve_closest_point = CurveClosestPoint(Point=point, Curve=flatten_tree)  # -> Point, Parameter, Distance
line = Line(StartPoint=point, EndPoint=curve_closest_point.Point)
min_building_count = Panel("5")
max_builging_count = Panel("20")
bounds = Bounds(Numbers=curve_closest_point.Distance)
construct_domain_3 = ConstructDomain(DomainStart=min_building_count, DomainEnd=max_builging_count)
remap_numbers_2 = RemapNumbers(Value=curve_closest_point.Distance, Source=bounds, Target=construct_domain_3)  # -> Mapped, Clipped
panel_2 = Panel(construct_domain_3)
populate_2d = Populate2D(Region=flatten_tree, Count=remap_numbers_2.Mapped, Seed=1)

# ----
panel_3 = Panel(curve_blocks)
curve_blocks_2 = Curve([<curve referenced from the Rhino model> x61])
point_2 = Point(populate_2d)

# ---- group: BUILDING FOOTPRINT
flatten_tree_2 = FlattenTree(Tree=curve_blocks_2, Path="{0}")
graft_tree = GraftTree(Tree=flatten_tree_2, IncludeEmptyLists=True, IncludeNullItems=True)
voronoi = Voronoi(Points=point_2, Boundary=graft_tree, BruteForceOverride=False)
simplify_tree = SimplifyTree(Tree=voronoi, Front=False)
rebuild_curve = RebuildCurve(Curve=simplify_tree, Count=Slider(4, range=0..10), Tangents=False)
curve = Curve(rebuild_curve)
