# Grasshopper definition Danai Sougkara - Assignment 2 - Buildings_Pt2.gh (Grasshopper 1.0.7)
# plug-ins: Human

# ---- group: Even_Building_Widths
curve = Curve(simplify(graft([<curve referenced from the Rhino model> x52])))
pt_attractor = Point([<point referenced from the Rhino model> x2])
num_maxwidth = Number("10")
num_minwidth = Number("4")

# ----
panel = Panel("100")  # disabled

# ---- group: Voronoi Buildings
num_buildingdensity = Number(panel)  # disabled
curve_2 = Curve(simplify(graft([<curve referenced from the Rhino model> x52])))  # disabled

bounding_box = BoundingBox(Content=curve_2, Plane=PlaneXY(0, 0, 0))  # -> Box, Box_2; disabled
area = Area(Geometry=bounding_box.Box)  # -> Area, Centroid; disabled
division = Division(A=area.Area, B=num_buildingdensity)  # disabled
populate_2d = Populate2D(Region=bounding_box.Box, Count=division, Seed=1)  # -> simplify(Population); disabled
point_in_curve = PointInCurve(Point=populate_2d, Curve=curve_2)  # -> Relationship, Point; disabled
cull_pattern = CullPattern(List=populate_2d, CullPattern=point_in_curve.Relationship)  # disabled
voronoi = Voronoi(Points=cull_pattern, Boundary=bounding_box.Box, BruteForceOverride=False)  # -> simplify(Cells); disabled
boundary_surfaces = BoundarySurfaces(Edges=voronoi)  # disabled
surface_split = SurfaceSplit(Surface=boundary_surfaces, Curves=curve_2)  # disabled
path_mapper = PathMapper(surface_split, source="{A;B}", target="{A}")  # disabled
area_2 = Area(Geometry=path_mapper)  # -> Area, Centroid; disabled
point_in_curve_2 = PointInCurve(Point=area_2.Centroid, Curve=curve_2)  # -> Relationship, Point; disabled
cull_pattern_2 = CullPattern(List=path_mapper, CullPattern=point_in_curve_2.Relationship)  # disabled
brep_edges = BrepEdges(Brep=cull_pattern_2)  # -> Naked, Interior, NonManifold; disabled
join_curves = JoinCurves(Curves=brep_edges.Naked, Preserve=False)  # disabled
panel_2 = Panel("1")  # disabled
panel_3 = Panel("4")  # disabled
rebuild_curve = RebuildCurve(Curve=join_curves, Degree=panel_2, Count=panel_3, Tangents=False)  # -> simplify(Curve); disabled
path_mapper_2 = PathMapper(rebuild_curve, source="{A;B}", target="{A}")  # disabled
crv_buildingfootprints = Curve(path_mapper_2)  # disabled

# ---- group: Building Height
crv_buildingfootprints_2 = Curve([<curve referenced from the Rhino model> x1730])
num_maxheight = Number("20")
num_maxadjust = Number("2")
num_minheight = Number("5")
num_minadjust = Number("0.9")
pt_attractor_2 = Point([<point referenced from the Rhino model> x2])

# ----
curve_to_polyline = CurveToPolyline(Curve=crv_buildingfootprints_2, ToleranceDistance=0, ToleranceAngle=0)  # -> Polyline, Segments
polygon_center = PolygonCenter(Polyline=curve_to_polyline.Polyline)  # -> CenterV, CenterE, CenterA

# ---- group: Building Height
distance = Distance(PointA=polygon_center.CenterV, PointB=pt_attractor_2)
sort_list = SortList(Keys=distance)  # -> Keys, ValuesValuesA
list_item = ListItem(List=sort_list.Keys, Index="0", Wrap=True)
bounds = Bounds(Numbers=flatten(list_item))
construct_domain = ConstructDomain(DomainStart=num_maxheight, DomainEnd=num_minheight)
remap_numbers = RemapNumbers(Value=list_item, Source=bounds, Target=Domain(0, 1))  # -> Mapped, Clipped
graph_mapper = GraphMapper(
    remap_numbers.Mapped,
    x0=0,
    x1=1,
    y0=0,
    y1=1,
    container_name="Bezier",
    cpx=[0, 0.2502839565, 0, 1],
    cpy=[0, 0.571187377, 1, 0.8533334136])
remap_numbers_2 = RemapNumbers(Value=graph_mapper, Source=Domain(0, 1), Target=construct_domain)  # -> Mapped, Clipped

construct_domain_2 = ConstructDomain(DomainStart=num_minadjust, DomainEnd=num_maxadjust)
list_length = ListLength(List=crv_buildingfootprints_2)
range = Range(Domain=construct_domain_2, Steps=expr("x-1", list_length))
unit_z = UnitZ(Factor=remap_numbers_2.Mapped)
duplicate_data = DuplicateData(Data=unit_z, Number=list_length, Order=True)
jitter = Jitter(List=range, Jitter=1, Seed=2)  # -> Values, Indices
multiplication = Multiplication(A=jitter.Values, B=duplicate_data)

# ----
move = Move(Geometry=crv_buildingfootprints_2, Motion=multiplication)  # -> Geometry, Transform

# ---- group: Building Height
control_points = ControlPoints(Curve=simplify(curve_to_polyline.Polyline))  # -> Points, Weights, Knots
vec_height = Vector(simplify(graft(multiplication)))
list_item_2 = ListItem(List=control_points.Points, Index="0", Wrap=True)
list_item_3 = ListItem(List=control_points.Points, Index="2", Wrap=True)
list_item_4 = ListItem(List=control_points.Points, Index="3", Wrap=True)
list_item_5 = ListItem(List=control_points.Points, Index="1", Wrap=True)
move_2 = Move(Geometry=list_item_5, Motion=vec_height)  # -> Geometry, Transform
move_3 = Move(Geometry=list_item_4, Motion=vec_height)  # -> Geometry, Transform
move_4 = Move(Geometry=list_item_2, Motion=vec_height)  # -> Geometry, Transform
move_5 = Move(Geometry=list_item_3, Motion=vec_height)  # -> Geometry, Transform
twisted_box = TwistedBox(
    CornerA=list_item_2,
    CornerB=list_item_5,
    CornerC=list_item_3,
    CornerD=list_item_4,
    CornerE=move_4.Geometry,
    CornerF=move_2.Geometry,
    CornerG=move_5.Geometry,
    CornerH=move_3.Geometry)

geo_buildingenvelope = Geometry(twisted_box)
mesh = Mesh(twisted_box)

# ---- group: HOUSES ON TERRAIN
brep = Brep(graft(geo_buildingenvelope))
bounding_box_2 = BoundingBox(Content=brep, Plane=PlaneXY(0, 0, 0))  # -> Box, Box_2
deconstruct_box = DeconstructBox(Box=bounding_box_2.Box)  # -> Plane, X, Y, Z
deconstruct_domain = DeconstructDomain(Domain=deconstruct_box.X)  # -> Start, End
deconstruct_domain_2 = DeconstructDomain(Domain=deconstruct_box.Y)  # -> Start, End
deconstruct_domain_3 = DeconstructDomain(Domain=deconstruct_box.Z)  # -> Start, End
subtraction = Subtraction(A=deconstruct_domain_3.End, B=deconstruct_domain_3.Start)
division_2 = Division(A=subtraction, B="4")
integer = Integer(division_2)
division_3 = Division(A=subtraction, B=integer)
division_4 = Division(A=division_3, B="2")
addition = Addition(A=deconstruct_domain_3.Start, B=division_4)
construct_point = ConstructPoint(XCoordinate=deconstruct_domain.Start, YCoordinate=deconstruct_domain_2.Start, ZCoordinate=addition)
mesh_brep = MeshBrep(
    Brep=brep,
    Settings={GridMaxCount=0, GridMinCount=16, JaggedSeams=False, MaxEdgeLength=0, MinEdgeLength=0.0001, MinTolerance=0, Refine=True, RefineAngle=0, RelativeTolerance=0.65, SimplePlanes=True, Tolerance=0})
center_box = CenterBox(Base=construct_point, X=division_4, Y=division_4, Z=division_4)
boxmapping = BoxMapping(Mesh=mesh_brep, Box=center_box)
file_path = FilePath("C:\Users\danai\Desktop\3. Winter 2022\Studio\water-texture-sea-nature-background-fluent.jpg")
custom_preview_materials = CustomPreviewMaterials(Geometry=boxmapping, DiffuseColor=RGB(255, 255, 255), DiffuseBitmap=file_path)
mesh_mappedenvelope = Mesh(boxmapping)

# ---- group: Even_Building_Widths
length = Length(Curve=curve)
area_3 = Area(Geometry=curve)  # -> Area, Centroid

distance_2 = Distance(PointA=area_3.Centroid, PointB=pt_attractor)
sort_list_2 = SortList(Keys=distance_2)  # -> Keys, ValuesValuesA
list_item_6 = ListItem(List=sort_list_2.Keys, Index="0", Wrap=True)
bounds_2 = Bounds(Numbers=flatten(list_item_6))
construct_domain_3 = ConstructDomain(DomainStart=num_maxwidth, DomainEnd=num_minwidth)
remap_numbers_3 = RemapNumbers(Value=list_item_6, Source=bounds_2, Target=Domain(0, 1))  # -> Mapped, Clipped
graph_mapper_2 = GraphMapper(
    remap_numbers_3.Mapped,
    x0=0,
    x1=1,
    y0=0,
    y1=1,
    container_name="Bezier",
    cpx=[0, 0.1170498431, 0.01050777733, 1],
    cpy=[0, 0.8235933781, 1, 1])
remap_numbers_4 = RemapNumbers(Value=graph_mapper_2, Source=Domain(0, 1), Target=construct_domain_3)  # -> Mapped, Clipped

division_5 = Division(A=length, B=remap_numbers_4.Mapped)
divide_curve = DivideCurve(Curve=curve, Count=division_5, Kinks=False)  # -> Points, Tangents, Parameters
shift_list = ShiftList(List=divide_curve.Points, Shift=1, Wrap=True)
line = Line(StartPoint=divide_curve.Points, EndPoint=shift_list)
crv_buildingfronts = Curve(line)

# ---- group: Building Depth
num_mindepth = Number("5")
num_maxdepth = Number("12")
curve_streets = Curve([<curve referenced from the Rhino model> x49])
crv_buildingfronts_2 = Curve(simplify(graft(crv_buildingfronts)))
pt_attractor_3 = Point([<point referenced from the Rhino model> x2])

curve_middle = CurveMiddle(Curve=crv_buildingfronts_2)
curve_closest_point = CurveClosestPoint(Point=curve_middle, Curve=curve_streets)  # -> Point, Parameter, Distance
sort_list_3 = SortList(Keys=curve_closest_point.Distance, ValuesValuesA=curve_closest_point.Point)  # -> Keys, ValuesValuesA
list_item_7 = ListItem(List=sort_list_3.ValuesValuesA, Index=0, Wrap=True)
vector_2pt = Vector2Pt(PointA=list_item_7, PointB=curve_middle, Unitize=False)  # -> Vector, Length
end_points = EndPoints(Curve=crv_buildingfronts_2)  # -> Start, End

distance_3 = Distance(PointA=curve_middle, PointB=pt_attractor_3)
sort_list_4 = SortList(Keys=distance_3)  # -> Keys, ValuesValuesA
list_item_8 = ListItem(List=sort_list_4.Keys, Index="0", Wrap=True)
bounds_3 = Bounds(Numbers=flatten(list_item_8))
construct_domain_4 = ConstructDomain(DomainStart=num_maxdepth, DomainEnd=num_mindepth)
remap_numbers_5 = RemapNumbers(Value=list_item_8, Source=bounds_3, Target=Domain(0, 1))  # -> Mapped, Clipped
graph_mapper_3 = GraphMapper(
    remap_numbers_5.Mapped,
    x0=0,
    x1=1,
    y0=0,
    y1=1,
    container_name="Bezier",
    cpx=[0, 0.471399188, 0, 1],
    cpy=[0, 0.2659885287, 1, 1])
remap_numbers_6 = RemapNumbers(Value=graph_mapper_3, Source=Domain(0, 1), Target=construct_domain_4)  # -> Mapped, Clipped

amplitude = Amplitude(Vector=vector_2pt.Vector, Amplitude=remap_numbers_6.Mapped)
move_6 = Move(Geometry=crv_buildingfronts_2, Motion=amplitude)  # -> Geometry, Transform
end_points_2 = EndPoints(Curve=move_6.Geometry)  # -> Start, End
merge = Merge(Data1=end_points.Start, Data2=end_points.End, Data3=end_points_2.End, Data4=end_points_2.Start)
polyline = PolyLine(Vertices=merge, Closed=True)
path_mapper_3 = PathMapper(polyline, source="{A;B}", target="{A}")
crv_buildingfootprints_3 = Curve(path_mapper_3)

# ---- group: Topography Footprints
crv_buildingfootprints_4 = Curve(crv_buildingfootprints_3)
srf_topo = Surface([<surface referenced from the Rhino model> x51])

control_points_2 = ControlPoints(Curve=crv_buildingfootprints_4)  # -> Points, Weights, Knots
unit_z_2 = UnitZ(Factor=1)
line_sdl = LineSDL(Start=control_points_2.Points, Direction=unit_z_2, Length=1)
surface_line = SurfaceLine(Surface=srf_topo, Line=line_sdl, LimitToFirst=False)  # -> Curves, Points, UVPoints, Normal
path_mapper_4 = PathMapper(surface_line.Points, source="{A;B;C}", target="{A;B}")
deconstruct = Deconstruct(Point=path_mapper_4)  # -> XComponent, YComponent, ZComponent
sort_list_5 = SortList(Keys=deconstruct.ZComponent, ValuesValuesA=path_mapper_4, ValuesB=control_points_2.Points)  # -> Keys, ValuesValuesA, ValuesB
list_item_9 = ListItem(List=sort_list_5.ValuesValuesA, Index=0, Wrap=True)
list_item_10 = ListItem(List=sort_list_5.ValuesB, Index=0, Wrap=True)
vector_2pt_2 = Vector2Pt(PointA=list_item_10, PointB=list_item_9, Unitize=False)  # -> Vector, Length
path_mapper_5 = PathMapper(vector_2pt_2.Vector, source="{A;B}", target="{A}")
move_7 = Move(Geometry=crv_buildingfootprints_4, Motion=path_mapper_5)  # -> Geometry, Transform
crv_buildingfootprints_5 = Curve(move_7.Geometry)
