# Grasshopper definition Danai Sougkara - Assignment 2 - Streets and Blocks.gh (Grasshopper 1.0.7)
# plug-ins: Human

geometry_pipeline = GeometryPipeline(
    GroupByLayer=False,
    GroupByType=False,
    IncludeHidden=True,
    IncludeLocked=True,
    LayerFilter="Roads*",
    NameFilter="*",
    SublayerFiltering=True,
    TypeFilter=4)
crv_boundary = Curve([<curve referenced from the Rhino model> x3])
boundary_surfaces = BoundarySurfaces(Edges=crv_boundary)
object_attributes = ObjectAttributes(ObjectOrAttributes=geometry_pipeline)  # -> graft(Name), LayerName, LayerFullPath, Color, MaterialName, LinetypeName, GroupIndices, PlotWeight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
panel = Panel(object_attributes.UserDataValues)
panel_2 = Panel(object_attributes.Name)

# ---- group: Split Blocks
offset_curve = OffsetCurve(Curve=geometry_pipeline, Distance=expr("-x/2", panel), Plane=PlaneXY(0, 0, 0), Corners=1)  # -> graft(Curve)
offset_curve_2 = OffsetCurve(Curve=geometry_pipeline, Distance=expr("x/2", panel), Plane=PlaneXY(0, 0, 0), Corners=1)  # -> graft(Curve)
end_points = EndPoints(Curve=offset_curve)  # -> Start, End
end_points_2 = EndPoints(Curve=offset_curve_2)  # -> Start, End
surface_split = SurfaceSplit(Surface=boundary_surfaces, Curves=geometry_pipeline)
line = Line(StartPoint=end_points.Start, EndPoint=end_points_2.Start)
line_2 = Line(StartPoint=end_points.End, EndPoint=end_points_2.End)
graft_tree = GraftTree(Tree=surface_split, IncludeEmptyLists=True, IncludeNullItems=True)
brep_edges = BrepEdges(Brep=graft_tree)  # -> Naked, Interior, NonManifold
join_curves = JoinCurves(Curves=[line_2, line, offset_curve, offset_curve_2], Preserve=False)
join_curves_2 = JoinCurves(Curves=brep_edges.Naked, Preserve=False)
flatten_tree = FlattenTree(Tree=join_curves, Path="{0}")
area = Area(Geometry=join_curves_2)  # -> Area, Centroid
surface_split_2 = SurfaceSplit(Surface=graft_tree, Curves=flatten_tree)
flatten_tree_2 = FlattenTree(Tree=area.Centroid, Path="{0}")
graft_tree_2 = GraftTree(Tree=surface_split_2, IncludeEmptyLists=True, IncludeNullItems=True)  # -> simplify(Tree)
surface_closest_point = SurfaceClosestPoint(Point=flatten_tree_2, Surface=graft_tree_2)  # -> Point, UVPoint, Distance
sort_list = SortList(Keys=surface_closest_point.Distance)  # -> Keys, ValuesValuesA
param_viewer = ParamViewer(graft_tree_2)
list_item = ListItem(List=sort_list.Keys, Index=0, Wrap=True)
smaller_than = SmallerThan(FirstNumber=list_item, SecondNumber="0.1")  # -> SmallerThan, OrEqualTo
cull_pattern = CullPattern(List=param_viewer, CullPattern=flatten(smaller_than.SmallerThan))
split_tree = SplitTree(Data=graft_tree_2, Masks=flatten(cull_pattern))  # -> Positive, Negative
surface = Surface(split_tree.Positive)
cull_pattern_2 = CullPattern(List=graft_tree_2, CullPattern=smaller_than.SmallerThan)
srf_blocks = Surface(cull_pattern_2)

# ----
pt_topography = Point([<point referenced from the Rhino model> x2])

# ---- group: Topography
divide_surface = DivideSurface(Surface=boundary_surfaces, UCount="25", VCount="25")  # -> Points, Normals, Parameters
graft_tree_3 = GraftTree(Tree=divide_surface.Points, IncludeEmptyLists=True, IncludeNullItems=True)
distance = Distance(PointA=pt_topography, PointB=graft_tree_3)
sort_list_2 = SortList(Keys=distance)  # -> Keys, ValuesValuesA
list_item_2 = ListItem(List=sort_list_2.Keys, Index=0, Wrap=True)

# ---- group: Topography / Remapping
flatten_tree_3 = FlattenTree(Tree=list_item_2, Path="{0}")
construct_domain = ConstructDomain(DomainStart="48", DomainEnd="0")
bounds = Bounds(Numbers=flatten_tree_3)
remap_numbers = RemapNumbers(Value=list_item_2, Source=bounds, Target=construct_domain)  # -> Mapped, Clipped

# ---- group: Topography (continued)
unit_z = UnitZ(Factor=remap_numbers.Mapped)
move = Move(Geometry=graft_tree_3, Motion=unit_z)  # -> simplify(Geometry), Transform
path_mapper = PathMapper(move.Geometry, source="{A;B}", target="{A}")
param_viewer_2 = ParamViewer(path_mapper)
list_length = ListLength(List=param_viewer_2)
surface_from_points = SurfaceFromPoints(Points=flatten(path_mapper), UCount=list_length, Interpolate=False)
point_list = PointList(Points=path_mapper, Size=4)
srf_topography = Surface(surface_from_points)

# ---- group: Block Topography
srf_topography_2 = Surface(srf_topography)
srf_blocks_2 = Surface(flatten(srf_blocks))

brep_edges_2 = BrepEdges(Brep=srf_blocks_2)  # -> Naked, Interior, NonManifold
join_curves_3 = JoinCurves(Curves=brep_edges_2.Naked, Preserve=False)
area_2 = Area(Geometry=join_curves_3)  # -> Area, Centroid
project = Project(Curve=join_curves_3, Brep=srf_topography_2, Direction=Vector(0, 0, 1))
surface_split_3 = SurfaceSplit(Surface=srf_topography_2, Curves=flatten(project))
line_sdl = LineSDL(Start=area_2.Centroid, Direction=Vector(0, 0, 1), Length="500")
surface_line = SurfaceLine(Surface=simplify(graft(surface_split_3)), Line=flatten(line_sdl), LimitToFirst=False)  # -> Curves, Points, UVPoints, Normal
path_mapper_2 = PathMapper(surface_line.Points, source="{A;B}", target="{A}")
list_length_2 = ListLength(List=path_mapper_2)
dispatch = Dispatch(List=graft(surface_split_3), DispatchPattern=list_length_2)  # -> ListA, ListB

srf_streets_parkinglot = Surface(dispatch.ListB)
srf_blocks_3 = Surface(dispatch.ListA)
